# Grasshopper definition MolaCSharpExample2.gh (Grasshopper 1.0.7)
# plug-ins: HDMolaGH

# ---- group: BoxGridAnalysisColor
boxgrid = CSharpScript(
    u=Slider(20, range=0..1010),
    h=Slider(2.2, range=0..10),
    Reference=["/Users/yang/Library/Application Support/McNeel/Rhinoceros/7.0/Plug-ins/Grasshopper (b45a29b1-4343-4035-989e-044e8580d9cf)/Libraries/HDMola.dll", "/Users/yang/Library/Application Support/McNeel/Rhinoceros/7.0/Plug-ins/Grasshopper (b45a29b1-4343-4035-989e-044e8580d9cf)/Libraries/netstandard.dll"])  # -> out, A; inputs u: Int32, v: Int32, h: Double
# ---------- boxgrid: C# usings ----------
using Mola;
# ---------- boxgrid: C# ----------
MolaMesh mesh = MeshFactory.CreateBox();
mesh = MeshSubdivision.Grid(mesh, u, u);
mesh = MeshSubdivision.ExtrudeToPointCenter(mesh, (float)h);
mesh = MeshTools.WeldVertices(mesh);
mesh = MeshSubdivision.CatmullClark(mesh);
mesh = MeshSubdivision.CatmullClark(mesh);
mesh =
A = mesh;
# ---------- end boxgrid ----------
analysis = CSharpScript(
    x=boxgrid.A,
    Reference=["/Users/yang/Library/Application Support/McNeel/Rhinoceros/7.0/Plug-ins/Grasshopper (b45a29b1-4343-4035-989e-044e8580d9cf)/Libraries/netstandard.dll", "/Users/yang/Library/Application Support/McNeel/Rhinoceros/7.0/Plug-ins/Grasshopper (b45a29b1-4343-4035-989e-044e8580d9cf)/Libraries/HDMola.dll"])  # -> out, A
# ---------- analysis: C# ----------
MolaMesh mesh = (MolaMesh)x;
mesh = MeshTools.WeldVertices(mesh);
List<float> values = MeshAnalysis.FaceArea(mesh);
mesh = MeshTools.Color(mesh, values);
A = mesh;
Print(values.Count.ToString());
# ---------- end analysis ----------
to_rhino = MolaToRhino(MolaMesh=analysis.A, WithColor=True)

# ---- group: TorusExtrudeColor
torus = CSharpScript(Reference=["/Users/yang/Library/Application Support/McNeel/Rhinoceros/7.0/Plug-ins/Grasshopper (b45a29b1-4343-4035-989e-044e8580d9cf)/Libraries/HDMola.dll", "/Users/yang/Library/Application Support/McNeel/Rhinoceros/7.0/Plug-ins/Grasshopper (b45a29b1-4343-4035-989e-044e8580d9cf)/Libraries/netstandard.dll"])  # -> out, A, B
# ---------- torus: C# ----------
MolaMesh mesh = MeshFactory.CreateTorus(5, 2, 30, 20);
List<Vec3> vectors = MeshAnalysis.FaceLocation(mesh);
List<float> heights = new List<float>();
List<float> fractions = new List<float>();
List<bool> caps = new List<bool>();
foreach(var v in vectors)
{
    float val = ((v.x +v.y) * 0.5f + 7)* 0.3f;
    heights.Add(val);
    fractions.Add(0.7f);
    caps.Add(true);
    }

mesh = MeshSubdivision.ExtrudeTapered(mesh, heights, fractions, caps);
mesh = MeshTools.WeldVertices(mesh);
mesh = MeshSubdivision.CatmullClark(mesh);
mesh = MeshTools.WeldVertices(mesh);
List<int> colors = MeshAnalysis.FaceIndex(mesh);
List<float> colorsfloat = new List<float>();
for(int i=0; i<colors.Count; i++)
{
    colorsfloat.Add((float)colors[i]);
}
mesh = MeshTools.Color(mesh, colorsfloat);
Print(mesh.FacesCount().ToString());
A = mesh;
B = heights;
# ---------- end torus ----------
to_rhino_2 = MolaToRhino(MolaMesh=torus.A, WithColor=Toggle(True))

# ----
panel = Panel(torus.out)
panel_2 = Panel(boxgrid.A)
panel_3 = Panel(analysis.out)
