# Grasshopper definition MolaInCSharp.gh (Grasshopper 1.0.7)
# plug-ins: HDMolaGH, ScriptParasite, MeshEdit Components

panel = Panel("-50 To 50")
number_slider = Slider(8, range=0..10)
geo = Geometry(<brep referenced from the Rhino model>)
pt = ConstructPoint(XCoordinate=0, YCoordinate=0, ZCoordinate=0)
pop3d = Populate3D(Region=geo, Count=number_slider, Seed=Slider(2, range=0..10))
pop3d_2 = Populate3D(Region=geo, Count=number_slider, Seed=Slider(8, range=0..10))
vec2pt = Vector2Pt(PointA=pt, PointB=pop3d, Unitize=False)  # -> Vector, Length
pt_2 = Point(pop3d_2)
unit = UnitVector(Vector=vec2pt.Vector)
random = Random(Range="20 To 40", Number=number_slider, Seed=Slider(2, range=0..10))
multiplication = Multiplication(A=unit, B=random)
move = Move(Geometry=pt_2, Motion=multiplication)  # -> Geometry, Transform
boxes = CSharpScript(
    x=pt_2,
    y=move.Geometry,
    Reference=["/Users/yang/GitHub/HDMolaNative/bin/Debug/netstandard2.1/HDMola.dll", "/Users/yang/GitHub/HDMolaNative/bin/Debug/netstandard2.1/HDMola.dll"])  # -> out, A; inputs x: list of Point3d, y: list of Point3d
# ---------- boxes: C# usings ----------
using Mola;
# ---------- boxes: C# ----------
    List<MolaMesh> meshes = new List<MolaMesh>();
    MolaMesh mesh = new MolaMesh();
    for (int i = 0; i < x.Count; i++)
    {
      float x1 = (float)x[i].X;
      float y1 = (float)x[i].Y;
      float z1 = (float)x[i].Z;
      float x2 = (float)y[i].X;
      float y2 = (float)y[i].Y;
      float z2 = (float)y[i].Z;

      mesh = MeshFactory.CreateBox(x1, y1, z1, x2, y2, z2);
      meshes.Add(mesh);
    }
    mesh = MeshTools.Merge(meshes);

    //mesh = MeshSubdivision.LinearSplitQuad(mesh, 2, 6);
    mesh = MeshSubdivision.Grid(mesh, 10, 10);
    mesh = MeshSubdivision.ExtrudeTapered(mesh, 10, 0.7f, true);
    mesh = MeshTools.WeldVertices(mesh);
    mesh = MeshTools.UpdateTopology(mesh);
    mesh = MeshSubdivision.CatmullClark(mesh);
    A = mesh;
# ---------- end boxes ----------
boxes_2 = CSharpScript(
    x=pt_2,
    y=move.Geometry,
    Reference=["/Users/yang/GitHub/HDMolaNative/bin/Debug/netstandard2.1/HDMola.dll", "/Users/yang/GitHub/HDMolaNative/bin/Debug/netstandard2.1/HDMola.dll"])  # -> out, A; inputs x: list of Point3d, y: list of Point3d
# ---------- boxes_2: C# ----------
    List<MolaMesh> meshes = new List<MolaMesh>();
    MolaMesh mesh = new MolaMesh();
    for (int i = 0; i < x.Count; i++)
    {
      float x1 = (float) x[i].X;
      float y1 = (float) x[i].Y;
      float z1 = (float) x[i].Z;
      float x2 = (float) y[i].X;
      float y2 = (float) y[i].Y;
      float z2 = (float) y[i].Z;

      mesh = MeshFactory.CreateBox(x1, y1, z1, x2, y2, z2);
      meshes.Add(mesh);
    }
    mesh = MeshTools.Merge(meshes);

    mesh = MeshSubdivision.LinearSplitQuad(mesh, 2, 6);
    mesh = MeshSubdivision.Grid(mesh, 10, 2);
    mesh = MeshSubdivision.ExtrudeTapered(mesh, 0, 0.3f, false);
    mesh = MeshTools.WeldVertices(mesh);
    //mesh = MeshTools.UpdateTopology(mesh);
    //mesh = MeshSubdivision.CatmullClark(mesh);
    A = mesh;
# ---------- end boxes_2 ----------
torus = CSharpScript(
    x=Slider(0, range=0..10),
    y=Slider(0.175, range=0..1),
    z=Slider(0.5, range=0..1),
    Reference=["C:\D\GitHub\HDMolaNative\bin\Debug\netstandard2.1\HDMola.dll", "C:\Users\Wenqian\AppData\Roaming\Grasshopper\Libraries\netstandard.dll"])  # -> out, A; inputs x: Double, y: Double, z: Double
# ---------- torus: C# ----------
    MolaMesh mesh = MeshFactory.CreateTetrahedron();
    mesh = MeshSubdivision.ExtrudeTapered(mesh, (float)x, 0.7f, false);
    mesh = MeshSubdivision.Grid(mesh, 2, 8);
    mesh = MeshSubdivision.ExtrudeTapered(mesh, (float)y, 0.8f, false);
    A = mesh;
# ---------- end torus ----------
number_slider_2 = Slider(1.9, range=0.2..5)
number_slider_3 = Slider(5, range=0..10)
number_slider_4 = Slider(2, range=0..10)
number_slider_5 = Slider(0.3, range=0..1)
number_slider_6 = Slider(2, range=0..2)
boxgrid = CSharpScript(
    x=number_slider_4,
    y=number_slider_3,
    z=number_slider_2,
    Reference=["/Users/yang/GitHub/HDMolaNative/bin/Debug/netstandard2.1/HDMola.dll", "/Users/yang/GitHub/HDMolaNative/bin/Debug/netstandard2.1/HDMola.dll"])  # -> out, A; inputs x: Int32, y: Int32, z: Double
# ---------- boxgrid: C# ----------
    MolaMesh mesh = MeshFactory.CreateBox();
    mesh = MeshSubdivision.Grid(mesh, x, y);

    mesh = MeshSubdivision.ExtrudeTapered(mesh, (float)z, 0.5f, true);
    mesh = MeshTools.WeldVertices(mesh);
    mesh = MeshTools.UpdateTopology(mesh);
    mesh = MeshSubdivision.CatmullClark(mesh);
    mesh = MeshSubdivision.CatmullClark(mesh);

    A = mesh;
# ---------- end boxgrid ----------
boxgrid_2 = CSharpScript(
    x=number_slider_4,
    y=number_slider_3,
    z=number_slider_2,
    Reference=["/Users/yang/GitHub/HDMolaNative/bin/Debug/netstandard2.1/HDMola.dll", "/Users/yang/GitHub/HDMolaNative/bin/Debug/netstandard2.1/HDMola.dll"])  # -> out, A; inputs x: Int32, y: Int32, z: Double
# ---------- boxgrid_2: C# ----------
    MolaMesh mesh = MeshFactory.CreateBox();
    mesh = MeshSubdivision.Grid(mesh, x, y);

    mesh = MeshSubdivision.ExtrudeTapered(mesh, (float) z, 0.5f, true);
    mesh = MeshTools.WeldVertices(mesh);
    mesh = MeshTools.UpdateTopology(mesh);
    mesh = MeshSubdivision.CatmullClark(mesh);
    mesh = MeshSubdivision.CatmullClark(mesh);

    A = mesh;
# ---------- end boxgrid_2 ----------
sphere = CSharpScript(
    x=Slider(8, range=4..20),
    y=Slider(2.8, range=0..3),
    Reference=["/Users/yang/GitHub/HDMolaNative/bin/Debug/netstandard2.1/HDMola.dll", "/Users/yang/GitHub/HDMolaNative/bin/Debug/netstandard2.1/HDMola.dll"])  # -> out, A; inputs x: Int32, y: Double
# ---------- sphere: C# ----------
    MolaMesh mesh = MeshFactory.CreateSphere(1, 0, 0, 0, x, x);
    mesh = MeshSubdivision.ExtrudeToPointCenter(mesh, (float)y);
    mesh = MeshTools.WeldVertices(mesh);
    mesh = MeshTools.UpdateTopology(mesh);
    mesh = MeshSubdivision.CatmullClark(mesh);
    A = mesh;
# ---------- end sphere ----------
box = CSharpScript(
    x=number_slider_6,
    y=number_slider_5,
    Reference=["/Users/yang/GitHub/HDMolaNative/bin/Debug/netstandard2.1/HDMola.dll", "/Users/yang/GitHub/HDMolaNative/bin/Debug/netstandard2.1/HDMola.dll"])  # -> out, A; inputs x: Double, y: Double
# ---------- box: C# ----------
    MolaMesh mesh = MeshFactory.CreateBox();
    //mesh = MeshSubdivision.Extrude(mesh, 0.2f);
    mesh = MeshSubdivision.Extrude(mesh, (float)x);
    mesh = MeshSubdivision.Extrude(mesh, (float)x);

    mesh = MeshSubdivision.ExtrudeTapered(mesh, 0, (float)y, false);
    mesh = MeshTools.Offset(mesh, 0.2f);

    A = mesh;
# ---------- end box ----------
torus_2 = CSharpScript()  # -> Out, A
boxw = CSharpScript(
    x=number_slider_6,
    y=number_slider_5,
    Reference=["/Users/yang/GitHub/HDMolaNative/bin/Debug/netstandard2.1/HDMola.dll", "/Users/yang/GitHub/HDMolaNative/bin/Debug/netstandard2.1/HDMola.dll"])  # -> out, A; inputs x: Double, y: Double
# ---------- boxw: C# ----------
    MolaMesh mesh = MeshFactory.CreateBox();
    //mesh = MeshSubdivision.Extrude(mesh, 0.2f);
    mesh = MeshSubdivision.Extrude(mesh, (float) x);
    mesh = MeshSubdivision.Extrude(mesh, (float) x);

    mesh = MeshSubdivision.ExtrudeTapered(mesh, 0, (float) y, false);
    mesh = MeshTools.Offset(mesh, 0.2f);

    A = mesh;
# ---------- end boxw ----------

house = CSharpScript(
    x=Slider(0, range=0..1),
    y=Slider(4.9, range=0..10),
    z=Slider(6, range=0..10),
    Reference=["C:\D\GitHub\HDMolaNative\bin\Debug\netstandard2.1\HDMola.dll", "C:\Users\Wenqian\AppData\Roaming\Grasshopper\Libraries\netstandard.dll"])  # -> out, A, value; inputs x: Double, y: Double, z: Int32
# ---------- house: C# ----------
    MolaMesh mesh = MeshFactory.CreateCone((float) y, (float) x, 0.5f, 3, z);
    mesh = MeshSubdivision.Grid(mesh, 2, 5);
    List<float> values = MeshAnalysis.FaceArea(mesh);
    values = values;
    A = mesh;
# ---------- end house ----------
scriptpar = ScriptParasite(Enable=Toggle(True), Folder="C:\D\GitHub\HDMolaNative\examples")

number_slider_7 = Slider(9, range=0..10)
to_rhino = MolaToRhino(MolaMesh=house.A, WithColor=Toggle(True))
sphere_2 = CSharpScript(
    x=number_slider_7,
    y=number_slider_7,
    z=Slider(0.9, range=0..1),
    Reference=["C:\D\GitHub\HDMolaNative\bin\Debug\netstandard2.1\HDMola.dll", "C:\Users\Wenqian\AppData\Roaming\Grasshopper\Libraries\netstandard.dll"])  # -> out, A; inputs x: Int32, y: Int32, z: Double
# ---------- sphere_2: C# ----------
    MolaMesh mesh = MeshFactory.CreateSphere(1, 0, 0, 0, x, y);
    mesh = MeshSubdivision.ExtrudeTapered(mesh, (float)z, 0.5f, false);
    mesh = MeshTools.WeldVertices(mesh);
    mesh = MeshTools.UpdateTopology(mesh);

    mesh = MeshTools.Offset(mesh, 0.2f);
    A = mesh;
# ---------- end sphere_2 ----------
demesh = DeconstructMesh(Mesh=to_rhino)  # -> Vertices, Faces, Colours, Normals
panel_2 = Panel(sphere.out)
area = MeshArea(Mesh=to_rhino)  # -> Area, Centroid
