# Grasshopper definition MolaInCSharpExamples.gh (Grasshopper 1.0.7)
# plug-ins: HDMolaGH

# ---- group: BoxGrid
boxgrid = CSharpScript(
    x=Slider(5, range=0..10),
    y=Slider(3, range=0..10),
    z=Slider(2, range=0..10),
    u=Slider(4, range=0..10),
    h=Slider(8.3, range=0..10),
    Reference=["C:\D\GITHUB\HDMOLANATIVE\EXAMPLES\netstandard.dll", "C:\D\GITHUB\HDMOLANATIVE\BIN\DEBUG\NETSTANDARD2.1\HDMola.dll"])  # -> out, A; inputs x: Double, y: Double, z: Double, u: Int32, h: Double
# ---------- boxgrid: C# usings ----------
using Mola;
# ---------- boxgrid: C# ----------
    MolaMesh mesh = MeshFactory.CreateBox(0, 0, 0, (float) x, (float) y, (float) z);
    mesh = MeshSubdivision.Grid(mesh, u, u);
    mesh = MeshSubdivision.ExtrudeToPointCenter(mesh, (float) h);
    mesh = MeshTools.WeldVertices(mesh);
    //mesh = MeshTools.UpdateTopology(mesh);
    mesh = MeshSubdivision.CatmullClark(mesh);
    mesh = MeshSubdivision.CatmullClark(mesh);
    mesh = MeshTools.WeldVertices(mesh);

    A = mesh;
# ---------- end boxgrid ----------
to_rhino = MolaToRhino(MolaMesh=boxgrid.A, WithColor=True)

# ---- group: Boxes
boxes = CSharpScript(
    x=Slider(1, range=0..10),
    y=Slider(0.6, range=0..1),
    Reference=["C:\D\GITHUB\HDMOLANATIVE\BIN\DEBUG\NETSTANDARD2.1\HDMola.dll", "C:\D\GITHUB\HDMOLANATIVE\EXAMPLES\netstandard.dll"])  # -> out, A; inputs x: Double, y: Double
# ---------- boxes: C# ----------
MolaMesh mesh = MeshFactory.CreateBox();
//mesh = MeshSubdivision.Extrude(mesh, 0.5f, true);
mesh = MeshSubdivision.Extrude(mesh, (float)x, true);
mesh = MeshSubdivision.Extrude(mesh, (float)x, true);

mesh = MeshSubdivision.ExtrudeTapered(mesh, 0.2f, (float)y, false);

A = mesh;
# ---------- end boxes ----------
to_rhino_2 = MolaToRhino(MolaMesh=boxes.A, WithColor=True)

# ---- group: Sphere
sphere = CSharpScript(
    radius=Slider(3, range=0..5),
    u=Slider(3, range=0..10),
    v=Slider(7, range=0..10),
    Reference=["C:\D\GITHUB\HDMOLANATIVE\EXAMPLES\netstandard.dll", "C:\D\GITHUB\HDMOLANATIVE\BIN\DEBUG\NETSTANDARD2.1\HDMola.dll"])  # -> out, A; inputs radius: Double, u: Int32, v: Int32
# ---------- sphere: C# ----------
MolaMesh mesh = MeshFactory.CreateSphere((float)radius, 0, 0, 0, u, v);
A = mesh;
# ---------- end sphere ----------
to_rhino_3 = MolaToRhino(MolaMesh=sphere.A, WithColor=Toggle(True))

# ---- group: Box
# To run this script:
# 1) Download 3 files from: https://moodle-app2.let.ethz.ch/mod/folder/view.php?id=1026980
# 2) Locate those 3 files in the grasshopper components folder
# 3) Right click each C# nodes —> manage assembllies —> add—> choose Mola.dll and netstandard.dll to add as assemblies.
number_slider = Slider(1, range=0..10)
box = CSharpScript(
    x=number_slider,
    y=Slider(10, range=0..10),
    z=Slider(5, range=0..10),
    Reference=["C:\D\GitHub\HDMolaNative\bin\Debug\netstandard2.1\HDMola.dll", "C:\D\GITHUB\HDMOLANATIVE\EXAMPLES\netstandard.dll"])  # -> out, A; inputs x: Double, y: Double, z: Double
# ---------- box: C# ----------
MolaMesh mesh = MeshFactory.CreateBox();
//mesh = MeshFactory.CreateBox(0, 0, 0, 2, 2, 2);
mesh = MeshFactory.CreateBox(0, 0, 0, (float)x, (float)y, (float)z);
A = mesh;
# ---------- end box ----------
to_rhino_4 = MolaToRhino(MolaMesh=box.A, WithColor=Toggle(True))

# ----
torus = CSharpScript(Reference=["C:\D\GitHub\HDMolaNative\bin\Debug\netstandard2.1\HDMola.dll", "C:\Users\Wenqian\AppData\Roaming\Grasshopper\Libraries\netstandard.dll"])  # -> out, A
# ---------- torus: C# ----------
    MolaMesh mesh = MeshFactory.CreateTorus(5, 2, 30, 20);
    //mesh = MeshSubdivision.ExtrudeTapered(mesh, 0.5f, 0.7f, true);
    List<Vec3> vectors = MeshAnalysis.FaceLocation(mesh);
    List<float> heights = new List<float>();
    List<bool> boolValues = new List<bool>();
    List<float> fractions = new List<float>();
    foreach(var v in vectors)
    {
      //heights.Add(v.x);
      float val = (v.x + 7) * 0.3f;
      heights.Add(val);
      //Print(v.x.ToString());
      boolValues.Add(true);
      fractions.Add(0.7f);
    }

    mesh = MeshSubdivision.ExtrudeTapered(mesh, heights, fractions, boolValues);
    mesh = MeshTools.UpdateTopology(mesh);
    mesh = MeshSubdivision.CatmullClark(mesh);
    mesh = MeshSubdivision.CatmullClark(mesh);
    mesh = MeshTools.WeldVertices(mesh);

    List<float> colors = MeshAnalysis.FaceArea(mesh);
    mesh = MeshTools.Color(mesh, colors);

    Print(mesh.FacesCount().ToString());

    A = mesh;
# ---------- end torus ----------

# ---- group: SphereFrame
sphereframe = CSharpScript(Reference=["C:\D\GITHUB\HDMOLANATIVE\EXAMPLES\netstandard.dll", "C:\D\GITHUB\HDMOLANATIVE\BIN\DEBUG\NETSTANDARD2.1\HDMola.dll"])  # -> out, A
# ---------- sphereframe: C# ----------
MolaMesh mesh = MeshFactory.CreateSphere();
mesh = MeshSubdivision.ExtrudeTapered(mesh, 0.2f, 0.5f, false);
mesh = MeshTools.WeldVertices(mesh);
mesh = MeshTools.UpdateTopology(mesh); 
mesh = MeshTools.Offset(mesh, 0.2f);

A = mesh;
# ---------- end sphereframe ----------
to_rhino_5 = MolaToRhino(MolaMesh=sphereframe.A, WithColor=True)

# ----
toggle = BooleanToggle(True)
analysis = CSharpScript(
    x=boxgrid.A,
    Reference=["C:\D\GITHUB\HDMOLANATIVE\EXAMPLES\netstandard.dll", "C:\D\GITHUB\HDMOLANATIVE\BIN\DEBUG\NETSTANDARD2.1\HDMola.dll"])  # -> out, A
# ---------- analysis: C# ----------
    MolaMesh mesh = (MolaMesh) x;
    mesh = MeshTools.WeldVertices(mesh);
    //mesh = MeshSubdivision.Extrude(mesh, 0.5f, true);
    //mesh = MeshSubdivision.Extrude(mesh, 0.5f, true);
    List<float> values = MeshAnalysis.FaceArea(mesh);
    mesh = MeshTools.Color(mesh, values);
    foreach(var item in values)
    {
      Print(item.ToString());
    }
    A = mesh;
# ---------- end analysis ----------
to_rhino_6 = MolaToRhino(MolaMesh=torus.A, WithColor=toggle)
to_rhino_7 = MolaToRhino(MolaMesh=analysis.A, WithColor=toggle)
panel = Panel(torus.out)
panel_2 = Panel(analysis.out)
