# Grasshopper definition diagrams.gh (Grasshopper 1.0.7)
# plug-ins: HDMolaGH

box = MolaBox(X1=0, Y1=0, Z1=0, X2=1, Y2=1, Z2=1)
number_slider = Slider(0.9, range=0..1)
toggle = BooleanToggle(False)
neg = Negative(Value=Slider(0.2, range=0..1))
split_grid_abs = SubdivideSplitGridAbs(MolaMesh=box, USize=Slider(0.5, range=0..1), VSize=Slider(0.2, range=0..1), Iteration=1)
to_rhino = MolaToRhino(MolaMesh=split_grid_abs, WithColor=False)
medges = MeshEdges(Mesh=to_rhino)  # -> NakedEdges, InteriorEdges, NonManifoldEdges
